# Dynamo graph Write Reabar rate.dyn "Write Rebar rate" (Dynamo 2.1.0.7500)

# group: Select the elements in view
all_elements_in_active_view = ElementsInView()

# group: Read reinforcement volume value
code_block = CodeBlock { "Estimated Reinforcement Volume"; }
getParameterValueByName = Element.GetParameterValueByName(element=all_elements_in_active_view, parameterName=code_block)

# group: Read concrete volume value
code_block_2 = CodeBlock { "Volume"; }
getParameterValueByName_2 = Element.GetParameterValueByName(element=all_elements_in_active_view, parameterName=code_block_2)

# group: Calculate reinforcement rate [kg/m³]
code_block_3 = CodeBlock { 1000000; }
div = getParameterValueByName / code_block_3
code_block_4 = CodeBlock { 7850; }
mul = div * code_block_4
div_2 = mul / getParameterValueByName_2
transpose = List.Transpose(lists=div_2)

# group: Write the result inside the shared parameter (You need to create the shared parameter "Rebar rate (kg/m3)" first.
code_block_5 = CodeBlock { "Rebar rate (kg/m3)"; }
setParameterByName = Element.SetParameterByName(element=all_elements_in_active_view, parameterName=code_block_5, value=transpose)
